# Grasshopper definition Sample2.ghx (Grasshopper 1.0.7)

push_to_bake = Button()
geo = Geometry()
revit_bake = CSharpScript(
    Geometry=geo,
    Bake=push_to_bake,
    Reference=["C:\USERS\MBREAU\SOURCE\REPOS\RHINO.INSIDE\AUTODESK\REVIT\BIN\DEBUG 2017\RhinoInside.Revit.dll", "C:\Program Files\Autodesk\Revit 2019\RevitAPIUI.dll", "C:\Program Files\Autodesk\Revit 2019\RevitAPI.dll"])  # -> out; inputs Geometry: list of GeometryBase, Bake: Boolean
# ---------- revit_bake: C# usings ----------
using RhinoInside.Revit;
# ---------- revit_bake: C# ----------
    if(Bake)
      Revit.BakeGeometry(Geometry, "");
# ---------- end revit_bake ----------
panel = Panel(revit_bake)
